# Grasshopper definition BlogOptimization.gh (Grasshopper 1.0.7)
# plug-ins: MetaHopper

number_slider = Slider(7, range=0..10)
genes = GenePool(Decimals=3, Maximum=1, Minimum=0, Value=[0.663, 0.556, 0.854, 0.169, 0.86, 0.223, 0.205])
dom = ConstructDomain(DomainStart=expr("-x", number_slider), DomainEnd=number_slider)
genes_2 = GenePool(Decimals=2, Maximum=1, Minimum=0, Value=[0.81, 0.43, 0.14, 0.16, 0.45, 0.45, 0.8])
rectangle = Rectangle(Plane=PlaneXY(0, 0, 0), XSize=dom, YSize=dom, Radius=0)  # -> Rectangle, Length
crv = Curve(rectangle.Rectangle)
pt = ConstructPoint(XCoordinate=genes, YCoordinate=genes_2, ZCoordinate=0)
genes_3 = GenePool(Decimals=2, Maximum=5, Minimum=2, Value=[2.17, 2, 2, 2.06, 2, 2.49, 2.86])
genes_4 = GenePool(Decimals=2, Maximum=5, Minimum=2, Value=[2.15, 2.33, 2, 2.04, 2, 2, 2.62])
evalsrf = EvaluateSurface(Surface=reparameterize(crv), Point=pt)  # -> Point, Normal, UDirection, VDirection, Frame
frgb = ColourRGBF(Alpha=1, Red=0, Green=Slider(1, range=0..1), Blue=0)
dom_2 = ConstructDomain(DomainStart=expr("-x", genes_4), DomainEnd=genes_4)
dom_3 = ConstructDomain(DomainStart=expr("-x", genes_3), DomainEnd=genes_3)
preview = CustomPreview(Geometry=crv, Material=frgb)
rectangle_2 = Rectangle(Plane=evalsrf.Point, XSize=dom_3, YSize=dom_2, Radius=0)  # -> Rectangle, Length
lng = ListLength(List=rectangle_2.Rectangle)
srf = Surface(rectangle_2.Rectangle)
runion = RegionUnion(Curves=flatten(rectangle_2.Rectangle))
runion_2 = RegionUnion(Curves=flatten([rectangle_2.Rectangle, crv]))
random = Random(Range=Domain(0, 1), Number=lng, Seed=Slider(1000, range=0..1000))
random_2 = Random(Range=Domain(0, 1), Number=lng, Seed=Slider(369, range=0..1000))
random_3 = Random(Range=Domain(0, 1), Number=lng, Seed=Slider(631, range=0..1000))
area = Area(Geometry=runion)  # -> Area, Centroid
area_2 = Area(Geometry=rectangle_2.Rectangle)  # -> Area, Centroid
area_3 = Area(Geometry=crv)  # -> Area, Centroid
crossref = CrossReference(ListA=rectangle_2.Rectangle, ListB=rectangle_2.Rectangle, CrossMode=5)  # -> ListA, ListB
frgb_2 = ColourRGBF(Alpha=1, Red=random, Green=random_2, Blue=random_3)
ma = MassAddition(Input=area_2.Area)  # -> Result, PartialResults
ma_2 = MassAddition(Input=area.Area)  # -> Result, PartialResults
area_4 = Area(Geometry=runion_2)  # -> Area, Centroid
ma_3 = MassAddition(Input=area_3.Area)  # -> Result, PartialResults
preview_2 = CustomPreview(Geometry=srf, Material=frgb_2)
graft = GraftTree(Tree=crossref.ListA, IncludeEmptyLists=True, IncludeNullItems=True)
graft_2 = GraftTree(Tree=crossref.ListB, IncludeEmptyLists=True, IncludeNullItems=True)

# ---- group: TakeScreenShotIterations
toggle = GroupToggle(ToggleActive=True, ToggleVisible=False)  # disabled
data = Data([genes, genes_2, genes_3, genes_4])
takescreenshot = CSharpScript(
    Run=Toggle(False),
    Reset=Button(),
    GalapagosSliders=flatten(data),
    Path="D:\Programas\felipunky.github.io\",
    ImageName="Packing")  # -> out; inputs Run: Boolean, Reset: Boolean, GalapagosSliders: list of Double, Path: String, ImageName: String
# ---------- takescreenshot: C# ----------
    string pather = Path + ImageName + counter.ToString();

    GH_Document ghDocument = Component.OnPingDocument();

    //double min = Expected * Min, max = Expected * Max;

    if(ghDocument.IsModified && Run == true )
    {

      //if( Fitness >= min && Fitness <= max  )
      {

        Rhino.RhinoApp.RunScript("_-ScreenCaptureToFile " + pather, true);

      }

      counter++;

    }

    if(Reset == true) counter = 0;

    Print(pather);
# ---------- takescreenshot: C# additional code ----------
  int counter = 0;
# ---------- end takescreenshot ----------
panel = Panel(takescreenshot)

# ----
item = ListItem(List=[graft, graft_2], Index=0, Wrap=True)  # -> Item, Item1
expression = Expression(x=ma_2.Result, y=ma.Result, Expression="abs(x-y)")
expression_2 = Expression(x=ma_3.Result, y=area_4.Area, Expression="abs(x-y)")
rint = RegionIntersection(CurvesA=item.Item, CurvesB=item.Item1)
number_slider_2 = Slider(1, range=0..1)
area_5 = Area(Geometry=rint)  # -> Area, Centroid
panel_2 = Panel(expression)
panel_3 = Panel(expression_2)
ma_4 = MassAddition(Input=flatten(area_5.Area))  # -> Result, PartialResults
null = NullItem(Item=ma_4.Result)  # -> NullFlags, InvalidFlags, Description
expression_3 = Expression(x=null.NullFlags, y=ma_4.Result, Expression="If( x = True, 0, y )")
ma_5 = MassAddition(Input=flatten([expression, panel_3, expression_3]))  # -> Result, PartialResults
galapagos = Galapagos(fitness=ma_5, gene=[genes, genes_2, genes_3, genes_4])
panel_4 = Panel(ma_5.Result)
